# Grasshopper definition TestGh.ghx (Grasshopper 1.0.7)

# ---- group: RH_IN:fl
num = Number()

# ---- group: RH_IN:breps
brep = Brep()

# ----
debrep = DeconstructBrep(Brep=brep)  # -> Faces, Edges, Vertices
Z = UnitZ(Factor=num)
item = ListItem(List=debrep.Faces, Index=0, Wrap=True)
move = Move(Geometry=item, Motion=Z)  # -> Geometry, Transform
area = Area(Geometry=item)  # -> Area, Centroid

# ---- group: RH_OUT:floors
srf = Surface(move.Geometry)

# ---- group: RH_OUT:area
num_2 = Number(area.Area)
